# Grasshopper definition test file.gh (Grasshopper 1.0.7)
# plug-ins: daylightingdesignspace, Dodo, SmithGroupTools, FalseStartToggle, Colibri, TT Toolbox

# GROUP TITLE
# Subtitle
core_items = Number(0)

# ----
# TITLE
# CREATED BY: NAME
# Description: Input script description here:
# SG Script Standards
# Quick Links
# Required: 1: Label big and often (60pt)
# 2: Highlight user controls and key items (red)
# 3: Number step-by-step instructions
# Recommended: 4: Group and label everything
# 5: Use pass-through containers to clarify inputs and outputs
stuck_ask_the_community = Button()
script_catalog = Button()
computation_sharepoint = Button()
x = PythonScript(x=stuck_ask_the_community)
# ---------- x: Python ----------
import webbrowser as wb
if x:
    url = 'https://teams.microsoft.com/l/channel/19%3a7b04d2f7a9db44649a89cc9ba0b42596%40thread.skype/%255E%2520Helpdesk?groupId=d6666e79-b216-41f0-9b42-1572b2b07b55&tenantId=a419c82f-5cb0-476b-a479-91ae8a7269f8'
    wb.open(url,2,True)
    print 'Happy downloading!'
else:
    print 'Set download to true...'
# ---------- end x ----------
x_2 = PythonScript(x=script_catalog)
# ---------- x_2: Python ----------
import webbrowser as wb
if x:
    url = 'http://sp.smithgroupjjr.com/disciplines/TIP/C/ScriptsViewer.aspx'
    wb.open(url,2,True)
    print 'Happy downloading!'
else:
    print 'Set download to true...'
# ---------- end x_2 ----------
# 1
x_3 = PythonScript(x=computation_sharepoint)
# ---------- x_3: Python ----------
import webbrowser as wb
if x:
    url = 'http://sp.smithgroupjjr.com/disciplines/TIP/C/default.aspx'
    wb.open(url,2,True)
    print 'Happy downloading!'
else:
    print 'Set download to true...'
# ---------- end x_3 ----------
openlogger = OpenLogger(Log=True)  # -> Success, Testing

important_items = Number(0)
suptrainnn = SupervisedTrainingNN()
param_1 = Panel("""shoo
2
3""")
param_2 = Panel("""foo
bazz
3""")
runnn = RunNeuralNetwork(NeuralNetwork=suptrainnn)  # -> Data, Weights, Threshold
iterator = ColibriIterator(param_2=param_2, param_1=param_1, RemoteFly=True, ignoreAllWarningMsg=False)  # -> param_2, param_1, Value_N, Genome, RemoteCtrl
rectangle = Rectangle(Plane=PlaneXY(0, 0, 0), XSize=Domain(-1, 1), YSize=iterator.param_2, Radius=0)  # -> Rectangle, Length
area = Area(Geometry=rectangle.Rectangle)  # -> Area, Centroid
area_2 = Number(area.Area)
path = FilePath("C:\Users\lcurtis\Documents\GitHub\daylighting-design-space\2019-1019 Daylighting Design Space.csv")
toggle = FalseStartToggle(True)
parameters = ColibriParameters(Area=flatten(area_2))
readxl = ReadExcelSheet(Run=toggle, FilePath=path, Worksheet="1", Listen=False)  # -> UserMessages, Columns, Rows
pt = Point(Point(0, 1, 0))
series = Series(Start=0, Step=1, Count=Slider(100, range=0..1000))
split = SplitList(List=readxl.Columns, Index="1")  # -> ListA, ListB
aggregator = ColibriAggregator(Folder="c:\Colibri", IterationGenomeID=iterator.Genome, IterationPhenomeResults=parameters, Write=False, recordingMode=3)
item = ListItem(List=split.ListB, Index=series, Wrap=True)  # -> simplify(Item)
num = Number(item)
bang = ExplodeTree(Data=simplify(num))  # -> Branch0, Branch1, Branch2, Branch3, Branch4, Branch5, Branch6, Branch7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
panel = Panel(bang.Branch2)
int = Integer(bang.Branch0)
panel_2 = Panel(bang.Branch0)
sim_repo = SimulationRepo(
    Data1=bang.Branch0,
    Data2=bang.Branch1,
    Data3=bang.Branch2,
    Data4=bang.Branch3,
    Data5=bang.Branch4,
    Data6=bang.Branch5,
    Data7=bang.Branch6,
    Data8=bang.Branch7,
    Data9=bang.Branch8,
    Data10=bang.Branch9,
    Data11=bang.Branch10,
    Data12=bang.Branch11,
    Data13=bang.Branch12,
    Data14=bang.Branch13,
    Data15=bang.Branch14,
    Data16=bang.Branch15,
    Data17=bang.Branch16,
    Data18=bang.Branch17,
    Data19=bang.Branch18,
    Dat20=bang.Branch19,
    Data21=bang.Branch20,
    Data22=bang.Branch21,
    Data23=bang.Branch22,
    Data24=bang.Branch23,
    BuildDatabase=Button())  # -> Genomes, Phenomes
flip = FlipMatrix(Data=item)
panel_3 = Panel("""location
orient
obstructAng
depth
ceilingHeight
wallThick
windowWidth
windowBsill
windowTsill
spaceBetween
wwr
shadeTrig""")
python = GhPythonScript(data=flip, key=panel_3)  # -> out, genome; inputs data: list, key: list
# ---------- python: Python ----------
__author__ = "lcurtis"
__version__ = "2019.10.20"

import rhinoscriptsyntax as rs
text = ''
for i in range(len(key)):
    text += ('[' + key[i] +',' + data[i] +']')

genome = text
# ---------- end python ----------
flip_2 = FlipMatrix(Data=python.genome)
item_2 = ListItem(List=flip_2, Index=Slider(0, range=0..100), Wrap=True)
panel_4 = Panel(item_2)
